# Dynamo graph gas piping.dyn (Dynamo 1.3.2.2480)

current = Document.Current()
activeView = Document.ActiveView(current)
categories = Categories("PipeCurves")
elements_in_view_by_category = Custom[Elements in view by category](View=activeView, Category=categories)  # Returns all the elements in the selected view(s) by the selected categor(y)(ies)
code_block = CodeBlock { "Flow"; }
parameterByName = Parameter.ParameterByName(element=elements_in_view_by_category, name=code_block)
value = Parameter.Value(parameterByName)
number = DoubleInput(448.832566)
mul = value * number
round = Math.Round(mul)
create = List.Create(elements_in_view_by_category, round)
